# Grasshopper definition Fspy to Rhino yotube 3dbeast.gh (Grasshopper 1.0.8)
# plug-ins: Heteroptera

# Fspy to rhino test 1
# www.youtube.com/c/3dbeast
# 
# 
# u can re distribute,re use as long as u give credit to channel page
# focal length
# 
# 
# 
# x
# 
# 
# 
# y
# 
# 
# 
# z
# 
# 
# 
# qx
# 
# 
# 
# qy
# 
# 
# 
# qz
# 
# 
# 
# qw
panel = Panel("")
pt = ConstructPoint()
python = GhPythonScript()  # -> Eu
# ---------- python: Python ----------
import math

t0 = +2.0 * (w * x + y * z)
t1 = +1.0 - 2.0 * (x * x + y * y)
roll_x = math.atan2(t0, t1)
t2 = +2.0 * (w * y - z * x)
t2 = +1.0 if t2 > +1.0 else t2
t2 = -1.0 if t2 < -1.0 else t2
pitch_y = math.asin(t2)
t3 = +2.0 * (w * z + x * y)
t4 = +1.0 - 2.0 * (y * y + z * z)
yaw_z = math.atan2(t3, t4)

Eu = [roll_x, pitch_y, yaw_z]
# ---------- end python ----------
yz = YZPlane(Origin=pt)
xz = XZPlane(Origin=pt)
xy = XYPlane(Origin=pt)
pt_2 = ConstructPoint(ZCoordinate=expr("x - 10", ""))
merge = Merge(Data1=yz, Data2=xz, Data3=xy)
Y = UnitY(Factor=1)
rotate = Rotate(Angle=python, Plane=merge)  # -> Geometry, Transform
line = LineSDL(Start=pt_2, Direction=Y, Length=1)
comp = Compound(Transforms=rotate.Transform)
transform = Transform(Geometry=line, Transform=comp)
transform_2 = Transform(Geometry=pt_2, Transform=comp)
camera = CameraCrane(Location=pt, Target=transform_2, Lense=panel, UPVector=transform, Refresh=Button())  # -> Camera, Target, Lens, Up, HorizontalViewAngle, VerticalViewAngle, ScreenRatio, Frame
crv = Curve(camera.Frame)
