# Grasshopper definition fspy automatic.gh (Grasshopper 1.0.8)
# plug-ins: RhinoCodePluginGH

file_path = FilePath()
read_file = ReadFile(File=file_path, PerLineParse=True)
list_item = ListItem(List=read_file, Index=0, Wrap=True)
number = Number([0, 1, 2, 3, 4, 5, 6, 7, 8, 9, 10, 11, 12, 13, 14, 15])
characters = Characters(Text=list_item)  # -> Result, Unicode
panel = Panel(number)
cull_index = CullIndex(List=characters.Result, Indices=number, Wrap=True)
text_join = TextJoin(Text=cull_index)
text_split = TextSplit(Text=text_join, Separators="�")
list_item_2 = ListItem(List=text_split, Index=0, Wrap=True)
panel_2 = Panel(list_item_2)
python_3_script = Python3Script(x=list_item_2)  # -> out, a, b, c, d
# ---------- python_3_script: Python ----------
import json    # or `import simplejson as json` if on Python < 2.6

json_string = x
obj = json.loads(json_string) 



a = obj["calibrationSettings1VP"]["absoluteFocalLength"]

b = obj['cameraParameters']['cameraTransform']['rows'][0][3]
c = obj['cameraParameters']['cameraTransform']['rows'][1][3]
d = obj['cameraParameters']['cameraTransform']['rows'][2][3]
# ---------- end python_3_script ----------
number_2 = Number(python_3_script.a)
number_3 = Number(python_3_script.b)
number_4 = Number(python_3_script.c)
number_5 = Number(python_3_script.d)
